# Requirement set stormNETRequirements (R2024a)
StormAD shall have a service-oriented architecture that integrates available
services from Brainstorm, Freesurfer, BIDS Apps, WSL and remote HPC

StromAD requires new services to be developed for Brainstorm:
 - importing PET data
 - modifying the database for PET data
 - co-registering PET data
 - anatomy computation remotely

## 1 [#1] Data Management (Container)
- The system shall store dataset information securely in a database
- The system shall store derivatives information securely in a database
- The system shall store user data securely in a database

### 1.1 [#5] Reads the structure of remote BIDS datasets
All metadata will be automatically extracted from the information contained in the BIDS JSON files, and inserted as new Brainstorm data entries for instantaneous availability.

#### 1.1.1 [#6] The system must handle communications with remote repositories (Informational)
- The system must handle communications with remote repositories

#### 1.1.2 [#7] The system must read BIDS datasets (Informational)

#### 1.1.3 [#8] The system must write BIDS Derivatives (Informational)

#### 1.1.4 [#9] Brainstorm database structure must import new BIDS-multimodal studies

### 1.2 [#38] The toolbox shall store the output of StormAD Core statistics in a database

#### 1.2.1 [#39] Vertex-wise measures

#### 1.2.2 [#40] Voxel-wise measures

### 1.3 [#41] The toolbox shall store references to StormAD derivative files in a database

### 1.4 [#68] Wrapper for local Linux processing
- linux runtime manager MATLAB

### 1.5 [#80] Must be able to import PET data into Brainstorm

### 1.6 [#86] The data management module shall provide a data catalogue

## 2 [#2] StormAD shall provide a GUI for exploring and analyzing available data catalogue (Container)
- The system shall provide a graphical user interface (GUI) for user interactions with a data catalogue.
- The system shall ensure the GUI is responsive and works on different screen sizes.
- The system shall integrate Brainstorm GUI functions.

### 2.1 [#44] GUI shall have a dashboard for dataset handling

#### 2.1.1 [#45] UI shall use LORIS API for visualizing remote repositories

#### 2.1.2 [#46] GUI shall have a module for multimodal StormAD format
Rationale: - The GUI shall show only the available data that is required for multimodal analysis in Brainstorm
Keywords: -

##### 2.1.2.1 [#47] Longitudinal
Rationale: - visit label
- anatomy data
- surface
- volume
- mri
- PET data
- SUVR
-tracer
- MEG data
- CSD
- Connectivity
- Travelling Waves

##### 2.1.2.2 [#48] Cross-sectional
Rationale: - anatomy data
- surface
- volume
- mri
- PET data
- SUVR
-tracer
- MEG data
- CSD
- Connectivity
- Travelling Waves

### 2.2 [#50] GUI shall have a dashboard for processing subjects

## 3 [#3] StormAD Core Functionalities (Container)
- Get subject anatomy
- Co-register modalities

### 3.1 [#18] Anatomy module (Container)

#### 3.1.1 [#11] The toolbox must process subject anatomy - if it does not already exist

#### 3.1.2 [#10] The toolbox must obtain subject anatomy - if it already exists

#### 3.1.3 [#64] The toolbox must export ROI-based morphological features

#### 3.1.4 [#65] Detailed analysis of entorhinal, peri-rhinal and hippocampus

### 3.2 [#17] PET module (Container)

#### 3.2.1 [#16] The toolbox must allow ROI analysis of PET

#### 3.2.2 [#13] The toolbox must import subject PET data - if it is already processed

#### 3.2.3 [#14] The toolbox must process PET data - if this does not already exist

#### 3.2.4 [#15] The toolbox must provide co-registration of PET with structural MR

### 3.3 [#19] MEG module (Container)

#### 3.3.1 [#21] MEG preprocessing

##### 3.3.1.1 [#22] Remove power-line harmonics through notch filtering

##### 3.3.1.2 [#23] Remove artefacts through ICA

###### 3.3.1.2.1 [#24] Identify and remove cardiac artefacts

###### 3.3.1.2.2 [#25] Identify and remove eyeblink artefacts

#### 3.3.2 [#20] MEG Current Density Mapping

#### 3.3.3 [#26] Register MEG to subject anatomy

#### 3.3.4 [#27] Compute MEG spectral features

##### 3.3.4.1 [#33] Band power

#### 3.3.5 [#28] Compute MEG connectivity

##### 3.3.5.1 [#29] Coherence

##### 3.3.5.2 [#30] Partial coherence

##### 3.3.5.3 [#31] Phase-locking value

##### 3.3.5.4 [#32] Granger causality

#### 3.3.6 [#34] MEG Travelling Waves

#### 3.3.7 [#66] MEG regional analysis (Container)

### 3.4 [#51] Cognition module (Container)

### 3.5 [#52] Demographic Module (Container)

### 3.6 [#53] Histology Module (Container)

### 3.7 [#54] Somatomotor module (Container)

### 3.8 [#55] Genetics Module (Container)

### 3.9 [#35] Statistics module (Container)

#### 3.9.1 [#36] Structure vertex-wise data from modules

##### 3.9.1.1 [#42] Each vertex must have an ID as a primary key

#### 3.9.2 [#37] Structure voxel-wise data from modules

##### 3.9.2.1 [#43] Each voxel must have an ID as a primary key

### 3.10 [#56] Machine Learning Module (Container)

#### 3.10.1 [#57] DL model to predict vertex-wise PET data from MEG

#### 3.10.2 [#58] Wrapper for Scikit-learn

#### 3.10.3 [#59] Classification and clustering

#### 3.10.4 [#60] Multivariate models to predict continuous values

#### 3.10.5 [#61] Multimodal biomarkers through longitudinal data
Rationale: Diagnostics and prognostic multimodal biomarkers

#### 3.10.6 [#62] Exporter for PyTorch

## 4 [#82] StormAD shall provide PET processsing services

## 5 [#67] StormAD shall provide processing in remote HPC (Container)
Target Computer
What can be used as a target computer:
- Any Linux machine that supports MATLAB® installation.
- Windows machine with Windows Subsystem for Linux (WSL2 version) installed.
  - WSL version 2 is required.
  - WSL Linux distros with minimum versions: Ubuntu 18.04/Debian 11/Oracle Linux_7_9 should be setup.
  - WSL target should be on the same windows host machine.
For more information, see https://in.mathworks.com/support/requirements/matlab-linux.html
Target Computer Requirements
To deploy Service Oriented Architecture applications on a target computer using the support package, following requirements have to be met.
- Docker software version 20.10 or later needs to be installed.
- Zip and Unzip commands needs to be installed.
- SSH server needs to be in running state.
- Target computer username needs to have privileges to run docker commands. For more information, see https://docs.docker.com/engine/install/linux-postinstall/#manage-docker-as-a-non-root-user.

### 5.1 [#4] User Configuration Module
The system must manage user accounts, including login credentials and user preferences for remote data repositories
The system must manage user accounts, including login credentials and user preferences for remote data repositories
Stores and manages user credentials
Configures remote environment (aliases, paths, etc.)
Saves and loads user preferences
Rationale: User login information is required to access remote repositories and processing pipelines

#### 5.1.1 [#63] The system shall store curated data for training ML models

#### 5.1.2 [#69] Store remote connection information locally (Informational)
The system must store:
- SSH keys
- remote user account
- remote server name
- remote HPC account name
- remote working directory
- remote dataset directory
- remote derivatives directory

#### 5.1.3 [#70] The system must store bash files for remote execution (Informational)

### 5.2 [#71] Sync local WSL with remote working directory

### 5.3 [#72] Remote execution module
Transfers bash scripts to the remote server
Executes scripts on the remote server
Retrieves and displays execution results

#### 5.3.1 [#73] Pass user enviroment to remote server

##### 5.3.1.1 [#75] Set working directory alias

##### 5.3.1.2 [#76] Set dataset directory alias

### 5.4 [#74] Feedback messages from remote server

### 5.5 [#78] StormRemote GUI for user interactions
Provides interface for user interactions
Allows selection of files/scripts to transfer
Displays connection status and execution results

### 5.6 [#79] Local file transfer module
For windows users,
Transfers files from Windows to WSL directory
Handles file permissions and path conversions

## 6 [#84] StormAD shall provide tools for longitudinal analysis

## 7 [#81] Identify critical state for conversion to AD
Streams of information that combines data from multiple source to infer **events** or patterns that suggest circumstances:
- critical point at which MCI converts to AD
- identify meaningful events to identify threats
- State control?

## 8 [#85] StormAD shall provide access to Alzheimer's disease datasets